# Grasshopper definition Open Path Slicer_v17.gh (Grasshopper 1.0.7)
# plug-ins: Human, Droid

# ---- group: Input
geo = Geometry(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)
extrusion_multiplier = Slider(2.5, range=0..10)
brep = Brep(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)
filament_diameter = Slider(1.75, range=0..3)
# Input Notes: This is where you put in the basic parameters of the model
setup_dam = BooleanToggle(True)
layer_height_maximum = Slider(0.6, range=0..5)
# Open Path Slicer
# v16, 7/12/23
# Made by Jasper Cohen
# Script Notes: Critial Dependencies:
# Pufferfish (tweening)
# 
# Tertiary Dependencies:
# Human (visualizing)
# Clipper (Skirt)
# Parakeed (skirt)
# Droid (save to file)
speed_mm_s = Slider(5, range=0..200)
nozzle_diameter = Slider(0.6, range=0..2)
gate = StreamGate(Stream=geo, Gate=setup_dam)  # -> Target0, Target1
gate_2 = StreamGate(Stream=brep, Gate=setup_dam)  # -> Target0, Target1

# ----
layer_number_calculator = LayerNumberCalculator(max_layer_height=layer_height_maximum, xy_path_brep=gate.Target1, top_brep=gate_2.Target1)
# Tweening Notes: Here rough layer geometry is automatically created based on how layer height and total height of the model. the idea is to have the thickness of the any section of a layer exceed the layer height maximum parameter
# 
# Dependecies: Pufferfish
surface_tweening = SurfaceTweening(division_info=layer_number_calculator, top_brep=gate_2.Target1, xy_path=gate.Target1)  # -> tweened_meshes, xy_toolpath_mesh, rough_layer_polylines

# ---- group: Spiralizing
polyline_cleaning = PolylineCleaning(rough_polylines=surface_tweening.rough_layer_polylines)
intersection_vector_creation = IntersectionVectorCreation(relay=polyline_cleaning)  # -> layer_points, layer_vectors
# Spiralizing Notes: Here the rough polylines are cleaned up and turned into a single continuous path.
# 
# I made this simply because i think continuous path printing is the optimimal print strategy.
# 
# Dependencies:
# Pufferfish
layer_spiralizer = LayerSpiralizer(relay=intersection_vector_creation.layer_points, middle_jump_vectors=intersection_vector_creation.layer_vectors)
preview = CustomPreview(
    Geometry=layer_spiralizer,
    Material={diffuse=RGB(221, 160, 221), emission=RGB(66, 48, 66), shine=0.5, specular=RGB(255, 255, 255), transparency=0})

# ---- group: Layer weaving
cluster = Cluster_2(relay=intersection_vector_creation.layer_points, middle_jump_vectors=intersection_vector_creation.layer_vectors)  # -> top_layer, ramp_down, middle_layers, ramp_up, bottom
purge_brim = Slider(7, range=0..10)
# Layer weaving Notes: Here the spiralized and non spiralized layers are woven together to create a final toolpath, along with an optional brim.
# 
# Dependencies:
# Pufferfish
# Clipper
# Parakeet
toggle = BooleanToggle(False)
cluster_2 = Cluster(
    top_layer=cluster.top_layer,
    ramp_down=cluster.ramp_down,
    middle=cluster.middle_layers,
    ramp_up=cluster.ramp_up,
    first_layer=cluster.bottom,
    skirt_distance=purge_brim,
    skirt_on_off=toggle)

# ---- group: Toolpath previewing
panel = Panel("""1
0""")
dispatch = Dispatch(List=cluster_2, DispatchPattern=panel)  # -> ListA, ListB
pline = PolyLine(Vertices=flatten(dispatch.ListA), Closed=False)
split = SplitTree(Data=dispatch.ListA, Masks=flatten("{30;*}"))  # -> Positive, Negative
pline_2 = PolyLine(Vertices=flatten(split.Positive), Closed=False)
previewlw = CustomPreviewLineweights(
    Geometry=pline,
    Shader=ColourSwatch(SwatchColor=RGB(255, 255, 255)),
    Thickness=Slider(3.632, range=0..10),
    Absolute=False)
previewlw_2 = CustomPreviewLineweights(Geometry=pline, Shader=ColourSwatch(SwatchColor=RGB(0, 0, 0)), Thickness=Slider(1.638, range=0..10), Absolute=False)

# ---- group: Final values calculations
panel_2 = Panel("""1
0""")
# Final value calculation Notes: Here the extrusion value is calculated, and concatinated with the rest of the data to form the final gcode
dispatch_2 = Dispatch(List=cluster_2, DispatchPattern=panel_2)  # -> ListA, ListB
extrusion_calculator = ExtrusionCalculator(
    V=dispatch_2.ListB,
    relay_2=nozzle_diameter,
    relay_3=layer_height_maximum,
    relay=filament_diameter,
    relay_4=extrusion_multiplier)
cluster_3 = Cluster_3(A=speed_mm_s, P=dispatch_2.ListA, x=extrusion_calculator)

# ---- group: GCODE output
# *set gcode to relative values with M83 command
# no g90 or g91 to clear m83 it seems
# PRE JUMP SEGMENTS
# ender 5 start code
# JUMP VECTORS
# Underlying problem:
# for some reason there is an extra row at the
# end of the list. im trimming it here
# but it shouldn't be there in the first
# place
# Final Toolpath
# Third
# first
# complete polyline toolpath
# Second
# ender 5 end gcode
# Second
# First
# Ordered E Values
# first, second, first, second, etc
# Flow Volume Calculation
# Underlying problem:
# for some reason there is an extra row at the
# end of the list. im trimming it here
# but it shouldn't be there in the first
# place
# Ramp Down (top)
# top
# bottom
# first
# Second
# bottom virgin vectors
saveg = DroidSaveGcode(Save=Button(), Gcode=cluster_3)

# ----
gcode_output_notes = Panel("""Dependecies:
Droid""")

# ==== cluster LayerNumberCalculator
xy_path_brep = ClusterInput()
top_brep = ClusterInput()
docinfo = DocumentInfo(AutoUpdate=False, Recursive=False)  # -> DocumentName, DocumentFilePath, Components, Params, _3rdPartyAssemblies
panel = Panel(docinfo._3rdPartyAssemblies)
max_layer_height = ClusterInput()

# ----
# Layer Division
# This cluster creates a list of numbers used to tween from top to base. The cluster seeks to make layers that do not exceed the given layer height.
split = SplitBrep(Brep=xy_path_brep, Cutter=top_brep)
number_slider = Slider(400, range=0..1000)
item = ListItem(List=split, Index="1", Wrap=True)
rectangle = Rectangle(Plane=PlaneXY(0, 0, 0), XSize=number_slider, YSize=number_slider, Radius=0)  # -> Rectangle, Length
split_2 = SplitBrep(Brep=item, Cutter=rectangle.Rectangle)
item_2 = ListItem(List=split_2, Index="0", Wrap=True)
bbox = BoundingBox(Content=item_2, Plane=PlaneXY(0, 0, 0), UnionBox=True)  # -> Box, Box_2
box_corners = BoxCorners(Box=bbox.Box_2)  # -> CornerA, CornerB, CornerC, CornerD, CornerE, CornerF, CornerG, CornerH
pdecon = Deconstruct(Point=box_corners.CornerE)  # -> XComponent, YComponent, ZComponent
pt = ConstructPoint(XCoordinate=pdecon.XComponent, YCoordinate=pdecon.YComponent, ZCoordinate="0")
dist_z = Distance(PointA=box_corners.CornerE, PointB=pt)
division = Division(A=dist_z, B=max_layer_height)
int = Integer(division)
division_2 = Division(A="1", B=int)
x_plus_one = XPlusOne(NumberX=int)
series = Series(Start=0, Step=division_2, Count=x_plus_one)

tweening_division_numbers = ClusterOutput(series)

# ==== cluster PolylineCleaning
rough_polylines = ClusterInput()

# ---- group: Polyline Cleaning
pcol = PolylineCollapse(Polyline=rough_polylines, Tolerance="0.005")  # -> Polyline, Count
join = JoinCurves(Curves=pcol.Polyline, Preserve=False)
cls = Closed(Curve=join)  # -> Closed, Periodic
dispatch = Dispatch(List=join, DispatchPattern=cls.Closed)  # -> ListA, ListB
lng = ListLength(List=dispatch.ListA)
x_plus_one = XPlusOne(NumberX=lng)
item = ListItem(List=dispatch.ListA, Index=x_plus_one, Wrap=True)
curvepoint = PointOnCurve(item, parameter=0.5)
alicrvseams = AlignCurveSeams(Curves=dispatch.ListA, Guide=curvepoint, Snap=False, Iterative=False)  # -> flatten(Aligned), Points, R
panel = Panel(curvepoint)
item_2 = ListItem(List=alicrvseams.Aligned, Index="0", Wrap=True)
flip = FlipCurve(Curve=alicrvseams.Aligned, Guide=item_2)  # -> Curve, Flag
simplify = SimplifyCurve(Curve=flip.Curve, Tolerance=".005", AngleTolerance=".25")  # -> Curve, Simplified
rev = ReverseList(List=simplify.Curve)

# ----
clean_layer_polylines = ClusterOutput(rev)

# ==== cluster SurfaceTweening
division_info = ClusterInput()
xy_path = ClusterInput()
top_brep = ClusterInput()

# ---- group: Layer Creation
mesh = MeshBrep(
    Brep=xy_path,
    Settings={GridMaxCount=0, GridMinCount=16, JaggedSeams=False, MaxEdgeLength=0, MinEdgeLength=0.0001, MinTolerance=0, Refine=True, RefineAngle=0, RelativeTolerance=0.65, SimplePlanes=True, Tolerance=0})
mesh_2 = MeshBrep(
    Brep=top_brep,
    Settings={GridMaxCount=0, GridMinCount=16, JaggedSeams=False, MaxEdgeLength=0, MinEdgeLength=0.0001, MinTolerance=0, Refine=True, RefineAngle=0, RelativeTolerance=0.65, SimplePlanes=True, Tolerance=0})
scale_nu = ScaleNU(Geometry=mesh_2, Plane=PlaneXY(0, 0, 0), ScaleX=1, ScaleY=1, ScaleZ=Slider(0, range=0..100))  # -> Geometry, Transform
twn2mshs = TweenTwoMeshes(MeshA=mesh_2, MeshB=scale_nu.Geometry, Factor=flatten(division_info), Colored=False)
mmx = MeshMesh(MeshA=twn2mshs, MeshB=mesh)  # -> flatten(Intersections)

# ----
xy_toolpath_mesh = ClusterOutput(mesh)
tweened_meshes = ClusterOutput(twn2mshs)
rough_layer_polylines = ClusterOutput(mmx)

# ==== cluster IntersectionVectorCreation
relay = ClusterInput()
split = SplitList(List=reverse(relay), Index="1")  # -> ListA, reverse(ListB)
split_2 = SplitList(List=relay, Index="1")  # -> ListA, ListB
preview = CustomPreview(
    Geometry=split_2.ListB,
    Material={diffuse=RGB(221, 160, 221), emission=RGB(66, 48, 66), shine=0.5, specular=RGB(255, 255, 255), transparency=0})
preview_2 = CustomPreview(
    Geometry=split.ListB,
    Material={diffuse=RGB(221, 160, 221), emission=RGB(66, 48, 66), shine=0.5, specular=RGB(255, 255, 255), transparency=0})
# Intersection Vector Creation
explode = Explode(Curve=split_2.ListB, Recursive=True)  # -> simplify(Segments), simplify(Vertices)
pframe = PerpFrame(Curve=explode.Segments, Parameter="0")
pcx = CurvePlane(Curve=graft(split.ListB), Plane=pframe)  # -> Points, ParamsC, ParamsP
trim = TrimTree(Tree=pcx.Points, Depth=1)
cp = ClosestPoint(Point=explode.Vertices, Cloud=trim)  # -> ClosestPoint, CPIndex, Distance
vec2pt = Vector2Pt(PointA=explode.Vertices, PointB=cp.ClosestPoint, Unitize=False)  # -> simplify(Vector), Length
vdisex = VectorDisplayEx(Point=explode.Vertices, Vector=vec2pt.Vector, Colour=RGB(0, 0, 0), Width=2)
viewer = ParamViewer(explode.Vertices)

# ---- group: Removing Last point and vector to avoid super close points
shift = ShiftList(List=reverse(vec2pt.Vector), Shift="1", Wrap=False)  # -> reverse(List)
shift_2 = ShiftList(List=reverse(explode.Vertices), Shift="1", Wrap=False)  # -> reverse(List)

# ----
viewer_2 = ParamViewer(shift_2)
layer_vectors = ClusterOutput(shift)
layer_points = ClusterOutput(shift_2)

# ==== cluster LayerSpiralizer
middle_jump_vectors = ClusterInput()
relay = ClusterInput()
lng = ListLength(List=middle_jump_vectors)
x_plus_one = XPlusOne(NumberX=lng)
series = Series(Start=0, Step=1, Count=x_plus_one)
vlen = VectorLength(Vector=reverse(middle_jump_vectors))
remap = RemapNumbers(Value=series, Source=lng, Target=Domain(0, 1))  # -> Mapped, Clipped
multiplication = Multiplication(A=vlen, B=remap.Mapped)  # -> reverse(Result)
amp = Amplitude(Vector=middle_jump_vectors, Amplitude=multiplication)  # -> simplify(Vector)
move = Move(Geometry=relay, Motion=amp)  # -> Geometry, Transform
vdis = VectorDisplay(Anchor=relay, Vector=amp)
pline = PolyLine(Vertices=move.Geometry, Closed=False)  # -> simplify(Polyline)
spiralized_rough_polylines = ClusterOutput(pline)
preview = CustomPreview(
    Geometry=pline,
    Material={diffuse=RGB(221, 160, 221), emission=RGB(66, 48, 66), shine=0.5, specular=RGB(255, 255, 255), transparency=0})

# ==== cluster Cluster
toggle = BooleanToggle(False)
ramp_up = ClusterInput()
top_layer = ClusterInput()
ramp_down = ClusterInput()
middle = ClusterInput()
first_layer = ClusterInput()
skirt_distance = ClusterInput()
skirt_on_off = ClusterInput()

# ---- group: Ramp Up
panel = Panel("""1
0""")
dispatch = Dispatch(List=ramp_up, DispatchPattern=panel)  # -> ListA, ListB
trim = TrimTree(Tree=dispatch.ListB, Depth=1)
trim_2 = TrimTree(Tree=dispatch.ListA, Depth=1)
lng = ListLength(List=trim)
x_plus_one = XPlusOne(NumberX=lng)
series = Series(Start=0, Step=1, Count=x_plus_one)
vlen = VectorLength(Vector=reverse(trim))
remap = RemapNumbers(Value=series, Source=lng, Target=Domain(0, 1))  # -> Mapped, Clipped
vlen_2 = VectorLength(Vector=trim)
multiplication = Multiplication(A=vlen, B=remap.Mapped)  # -> reverse(Result)
multiplication_2 = Multiplication(A=vlen_2, B=remap.Mapped)
amp = Amplitude(Vector=trim, Amplitude=multiplication)  # -> simplify(Vector)
amp_2 = Amplitude(Vector=trim, Amplitude=multiplication_2)  # -> simplify(Vector)
move = Move(Geometry=trim_2, Motion=amp)  # -> simplify(Geometry), Transform
pline = PolyLine(Vertices=move.Geometry, Closed=False)  # -> flatten(Polyline)
explode = Explode(Curve=pline, Recursive=True)  # -> Segments, Vertices
graft = GraftTree(Tree=amp_2, IncludeEmptyLists=True, IncludeNullItems=True)
path_mapper = PathMapper(graft, source="{A;0;B}", target="{A;B}")
pline_2 = PolyLine(Vertices=flatten(explode.Vertices), Closed=False)
weave = Weave(Pattern=[0, 1], Stream0=graft(explode.Vertices), Stream1=graft(path_mapper), NullGaps=False)  # -> simplify(Weave)
vdis = VectorDisplay(Anchor=explode.Vertices, Vector=amp_2)
path_mapper_2 = PathMapper(weave, source="{A}", target="{1;A}")

# ---- group: Ramp Down
panel_2 = Panel("""1
0""")
dispatch_2 = Dispatch(List=ramp_down, DispatchPattern=panel_2)  # -> ListA, ListB
trim_3 = TrimTree(Tree=dispatch_2.ListB, Depth=1)
trim_4 = TrimTree(Tree=dispatch_2.ListA, Depth=1)
lng_2 = ListLength(List=trim_3)
series_2 = Series(Start=0, Step=1, Count=lng_2)
vlen_3 = VectorLength(Vector=reverse(trim_3))
remap_2 = RemapNumbers(Value=series_2, Source=lng_2, Target=Domain(0, 1))  # -> reverse(Mapped), Clipped
vlen_4 = VectorLength(Vector=trim_3)
multiplication_3 = Multiplication(A=vlen_3, B=remap_2.Mapped)
multiplication_4 = Multiplication(A=vlen_4, B=remap_2.Mapped)
amp_3 = Amplitude(Vector=trim_3, Amplitude=multiplication_3)  # -> simplify(Vector)
amp_4 = Amplitude(Vector=trim_3, Amplitude=multiplication_4)  # -> simplify(Vector)
move_2 = Move(Geometry=trim_4, Motion=amp_3)  # -> simplify(Geometry), Transform
pline_3 = PolyLine(Vertices=trim_4, Closed=False)
explode_2 = Explode(Curve=pline_3, Recursive=True)  # -> Segments, graft(Vertices)
graft_2 = GraftTree(Tree=amp_4, IncludeEmptyLists=True, IncludeNullItems=True)
path_mapper_3 = PathMapper(graft_2, source="{A;0;B}", target="{A;B}")
path_mapper_4 = PathMapper(explode_2.Vertices, source="{A;0;B}", target="{A;B}")
preview = CustomPreview(
    Geometry=trim_4,
    Material={diffuse=RGB(221, 160, 221), emission=RGB(66, 48, 66), shine=0.5, specular=RGB(255, 255, 255), transparency=0})
pline_4 = PolyLine(Vertices=flatten(explode_2.Vertices), Closed=False)
vdis_2 = VectorDisplay(Anchor=explode_2.Vertices, Vector=amp_4)
weave_2 = Weave(Pattern=[0, 1], Stream0=graft(path_mapper_4), Stream1=graft(path_mapper_3), NullGaps=False)
path_mapper_5 = PathMapper(weave_2, source="{A;B;0}", target="{A;B}")

# ---- group: Plain Spiralizer
panel_3 = Panel("""1
0""")
dispatch_3 = Dispatch(List=middle, DispatchPattern=panel_3)  # -> ListA, ListB
trim_5 = TrimTree(Tree=dispatch_3.ListA, Depth=1)
trim_6 = TrimTree(Tree=dispatch_3.ListB, Depth=1)
lng_3 = ListLength(List=trim_6)
x_plus_one_2 = XPlusOne(NumberX=lng_3)
series_3 = Series(Start=0, Step=1, Count=x_plus_one_2)
vlen_5 = VectorLength(Vector=reverse(trim_6))
remap_3 = RemapNumbers(Value=series_3, Source=lng_3, Target=Domain(0, 1))  # -> Mapped, Clipped
multiplication_5 = Multiplication(A=vlen_5, B=remap_3.Mapped)  # -> reverse(Result)
amp_5 = Amplitude(Vector=trim_6, Amplitude=multiplication_5)  # -> simplify(Vector)
move_3 = Move(Geometry=trim_5, Motion=amp_5)  # -> Geometry, Transform
vdis_3 = VectorDisplay(Anchor=trim_5, Vector=amp_5)
pline_5 = PolyLine(Vertices=move_3.Geometry, Closed=False)  # -> simplify(Polyline)
explode_3 = Explode(Curve=pline_5, Recursive=True)  # -> Segments, Vertices
weave_3 = Weave(Pattern=[0, 1], Stream0=graft(explode_3.Vertices), Stream1=graft(trim_6), NullGaps=False)  # -> simplify(Weave)
pline_6 = PolyLine(Vertices=flatten(explode_3.Vertices), Closed=False)

# ----
viewer = ParamViewer(trim_5)
viewer_2 = ParamViewer(trim_6)
viewer_3 = ParamViewer(trim_6)
viewer_4 = ParamViewer(explode_3.Vertices)
panel_4 = Panel("""1
0""")
number_slider = Slider(29, range=0..100)
panel_5 = Panel(path_mapper_5)
viewer_5 = ParamViewer(path_mapper_5)
item = ListItem(List=explode_3.Vertices, Index=number_slider, Wrap=True)
item_2 = ListItem(List=trim_6, Index=number_slider, Wrap=True)
dispatch_4 = Dispatch(List=path_mapper_5, DispatchPattern=panel_4)  # -> ListA, ListB
vlen_6 = VectorLength(Vector=item_2)
panel_6 = Panel(vlen_6)
vdisex = VectorDisplayEx(Point=item, Vector=item_2, Colour=RGB(0, 0, 0), Width=2)
pline_7 = PolyLine(Vertices=flatten(dispatch_4.ListA), Closed=False)

# ---- group: Diagnostic Guff
# im getting there, but i need to rearrange some layers
panel_7 = Panel("""1
0""")
dispatch_5 = Dispatch(List=path_mapper_5, DispatchPattern=panel_7)  # -> ListA, ListB
viewer_6 = ParamViewer(dispatch_5.ListA)
panel_8 = Panel("""1
0""")
vdisex_2 = VectorDisplayEx(Point=dispatch_5.ListA, Vector=dispatch_5.ListB, Colour=RGB(0, 0, 0), Width=2)
panel_9 = Panel("""1
0""")
dispatch_6 = Dispatch(List=weave_3, DispatchPattern=panel_8)  # -> ListA, ListB
panel_10 = Panel(dispatch_5.ListA)
dispatch_7 = Dispatch(List=path_mapper_2, DispatchPattern=panel_9)  # -> ListA, ListB
pline_8 = PolyLine(Vertices=flatten(dispatch_6.ListA), Closed=False)
pline_9 = PolyLine(Vertices=flatten(dispatch_7.ListA), Closed=False)
vdisex_3 = VectorDisplayEx(Point=dispatch_6.ListA, Vector=dispatch_6.ListB, Colour=RGB(0, 0, 0), Width=2)
vdisex_4 = VectorDisplayEx(Point=dispatch_7.ListA, Vector=dispatch_7.ListB, Colour=RGB(0, 0, 0), Width=2)
preview_2 = CustomPreview(
    Geometry=pline_9,
    Material={diffuse=RGB(221, 160, 221), emission=RGB(66, 48, 66), shine=0.5, specular=RGB(255, 255, 255), transparency=0})

# ----
panel_11 = Panel("""1
0""")
dispatch_8 = Dispatch(List=first_layer, DispatchPattern=panel_11)  # -> ListA, ListB
pline_10 = PolyLine(Vertices=flatten(dispatch_8.ListA), Closed=False)
panel_12 = Panel("Clipper dependency")
curvepoint = PointOnCurve(pline_10, parameter=1)
polyoffset = PolylineOffset(
    Polylines=pline_10,
    Distance=skirt_distance,
    Plane=Plane(origin=(0, 0, 0), x=(0, 0, 0), y=(0, 0, 0)),
    Tolerance=0.001,
    ClosedFillet=1,
    OpenFillet=1,
    Miter=2)  # -> Contour, Holes
item_3 = ListItem(List=flatten(dispatch_8.ListB), Index=0, Wrap=True)
path_mapper_6 = PathMapper(top_layer, source="{A;B}", target="{A+1;B}")
path_mapper_7 = PathMapper(path_mapper_5, source="{A;B}", target="{A+1;B}")
panel_13 = Panel("Parakeet dependency")
aligncrv = AlignCurves(Curves=polyoffset.Contour, Guide=pline_10)
docinfo = DocumentInfo(AutoUpdate=False, Recursive=False)  # -> DocumentName, DocumentFilePath, Components, Params, _3rdPartyAssemblies
path_mapper_8 = PathMapper(path_mapper_2, source="{A;B}", target="{A+1;B}")
explode_4 = Explode(Curve=aligncrv, Recursive=True)  # -> Segments, Vertices
path_mapper_9 = PathMapper(weave_3, source="{A;B}", target="{A+1;B}")
path_mapper_10 = PathMapper(path_mapper_6, source="{A;B}", target="{A+1;B}")
panel_14 = Panel(docinfo._3rdPartyAssemblies)
path_mapper_11 = PathMapper(path_mapper_7, source="{A;B}", target="{A+1;B}")
curvepoint_2 = PointOnCurve(aligncrv, parameter=1)
path_mapper_12 = PathMapper(first_layer, source="{A;B}", target="{A+1;B}")
weave_4 = Weave(Pattern=[0, 1], Stream0=graft(explode_4.Vertices), Stream1=item_3, NullGaps=False)
preview_3 = CustomPreview(
    Geometry=curvepoint,
    Material={diffuse=RGB(221, 160, 221), emission=RGB(66, 48, 66), shine=0.5, specular=RGB(255, 255, 255), transparency=0})
viewer_7 = ParamViewer(first_layer)
preview_4 = CustomPreview(
    Geometry=curvepoint_2,
    Material={diffuse=RGB(221, 160, 221), emission=RGB(66, 48, 66), shine=0.5, specular=RGB(255, 255, 255), transparency=0})
path_mapper_13 = PathMapper(weave_4, source="{A;0;0;B}", target="{A;B}")
viewer_8 = ParamViewer(path_mapper_12)
gate = StreamGate(Stream=path_mapper_13, Gate=skirt_on_off)  # -> Target0, Target1
viewer_9 = ParamViewer(gate.Target1)
viewer_10 = ParamViewer(path_mapper_13)
merge = Merge(
    Data1=gate.Target1,
    Data2=path_mapper_12,
    Data3=path_mapper_8,
    Data4=path_mapper_9,
    Data5=path_mapper_11,
    Data6=path_mapper_10)
R = ClusterOutput(merge)

# ==== cluster Cluster_2
middle_jump_vectors = ClusterInput()
relay = ClusterInput()

# ---- group: Layer Organization
weave = Weave(Pattern=[0, 1], Stream0=graft(relay), Stream1=graft(middle_jump_vectors), NullGaps=False)  # -> simplify(Weave)
vdisex = VectorDisplayEx(Point=relay, Vector=middle_jump_vectors, Colour=RGB(0, 0, 0), Width=2)
trim = TrimTree(Tree=weave, Depth=1)
tstat = TreeStatistics(Tree=trim)  # -> flatten(Paths), Length, Count
lng = ListLength(List=tstat.Paths)
subtraction = Subtraction(A=lng, B="1")
split = SplitTree(Data=weave, Masks=flatten("{0;*}"))  # -> Positive, Negative
panel = Panel("""1
0""")
panel_2 = Panel(subtraction)
concat = Concatenate(FragmentA="{", FragmentE=subtraction, FragmentB="to", FragmentF=lng, FragmentC=";*}")
dispatch = Dispatch(List=split.Positive, DispatchPattern=panel)  # -> ListA, ListB
vdisex_2 = VectorDisplayEx(Point=dispatch.ListA, Vector=dispatch.ListB, Colour=RGB(0, 0, 0), Width=2)
pline = PolyLine(Vertices=flatten(dispatch.ListA), Closed=False)
preview = CustomPreview(
    Geometry=pline,
    Material={diffuse=RGB(221, 160, 221), emission=RGB(66, 48, 66), shine=0.5, specular=RGB(255, 255, 255), transparency=0})
split_2 = SplitTree(Data=split.Negative, Masks=flatten(concat))  # -> Positive, Negative
panel_3 = Panel("""1
0""")
dispatch_2 = Dispatch(List=split_2.Positive, DispatchPattern=panel_3)  # -> ListA, ListB
vdisex_3 = VectorDisplayEx(Point=dispatch_2.ListA, Vector=dispatch_2.ListB, Colour=RGB(0, 0, 0), Width=2)
x_minus_one = XMinusOne(NumberX=subtraction)
split_3 = SplitTree(Data=split_2.Negative, Masks=flatten("{1;*}"))  # -> Positive, Negative
concat_2 = Concatenate(FragmentA="{", FragmentE=x_minus_one, FragmentB=";*}")
panel_4 = Panel("""1
0""")
dispatch_3 = Dispatch(List=split_3.Positive, DispatchPattern=panel_4)  # -> ListA, ListB
split_4 = SplitTree(Data=split_3.Negative, Masks=flatten(concat_2))  # -> Positive, Negative
vdisex_4 = VectorDisplayEx(Point=dispatch_3.ListA, Vector=dispatch_3.ListB, Colour=RGB(0, 0, 0), Width=2)
panel_5 = Panel("""1
0""")
panel_6 = Panel("""1
0""")
dispatch_4 = Dispatch(List=split_3.Negative, DispatchPattern=panel_6)  # -> ListA, ListB
dispatch_5 = Dispatch(List=split_4.Positive, DispatchPattern=panel_5)  # -> ListA, ListB
panel_7 = Panel("""1
0""")
vdisex_5 = VectorDisplayEx(Point=dispatch_4.ListA, Vector=dispatch_4.ListB, Colour=RGB(0, 0, 0), Width=2)
vdisex_6 = VectorDisplayEx(Point=dispatch_5.ListA, Vector=dispatch_5.ListB, Colour=RGB(0, 0, 0), Width=2)
dispatch_6 = Dispatch(List=split_2.Positive, DispatchPattern=panel_7)  # -> ListA, ListB
pline_2 = PolyLine(Vertices=flatten(dispatch.ListA), Closed=False)
pline_3 = PolyLine(Vertices=flatten(dispatch_5.ListA), Closed=False)
pline_4 = PolyLine(Vertices=flatten(dispatch_3.ListA), Closed=False)
pline_5 = PolyLine(Vertices=flatten(dispatch_6.ListA), Closed=False)
pline_6 = PolyLine(Vertices=flatten(dispatch_4.ListA), Closed=False)

# ----
bottom = ClusterOutput(split.Positive)
ramp_up = ClusterOutput(split_3.Positive)
top_layer = ClusterOutput(split_2.Positive)
ramp_down = ClusterOutput(split_4.Positive)
middle_layers = ClusterOutput(split_3.Negative)

# ==== cluster Cluster_3
P = ClusterInput()
A = ClusterInput()
pdecon = Deconstruct(Point=flatten(P))  # -> XComponent, YComponent, ZComponent
x = ClusterInput()
multiplication = Multiplication(A=A, B="60")
roundd = RoundToDecimalPlace(NumberX=pdecon.XComponent, DecimalPlace="3", RoundType=0)  # -> Rounded, Difference
roundd_2 = RoundToDecimalPlace(NumberX=pdecon.YComponent, DecimalPlace="3", RoundType=0)  # -> Rounded, Difference
roundd_3 = RoundToDecimalPlace(NumberX=pdecon.ZComponent, DecimalPlace="3", RoundType=0)  # -> Rounded, Difference
roundd_4 = RoundToDecimalPlace(NumberX=x, DecimalPlace="5", RoundType=0)  # -> Rounded, Difference
panel = Panel("F")
concat = Concatenate(
    FragmentH="G1 ",
    FragmentA=" X",
    FragmentB=roundd.Rounded,
    FragmentC=" Y",
    FragmentD=roundd_2.Rounded,
    FragmentE=" Z",
    FragmentF=roundd_3.Rounded,
    FragmentI=" E",
    FragmentK=roundd_4.Rounded)
panel_2 = Panel(multiplication)
# G90 ; use absolute coordinates
# M83 ; extruder relative mode
# M140 S{first_layer_bed_temperature[0]} ; set final bed temp
# M104 S150 ; set temporary nozzle temp to prevent oozing during homing and auto bed leveling
# M190 S{first_layer_bed_temperature[0]} ; wait for bed temp to stabilize
# G28 ; home all axis
# G29 ; auto bed levelling
# G1 Z50 F240
# G1 X2 Y10 F3000
# M104 S{first_layer_temperature[0]} ; set final nozzle temp
# M109 S{first_layer_temperature[0]} ; wait for nozzle temp to stabilize
# G1 Z0.28 F240
# G92 E0
# G1 Y140 E10 F1500 ; prime the nozzle
# G1 X2.3 F5000
# G92 E0
# G1 Y10 E10 F1200 ; prime the nozzle
# G92 E0
panel_3 = Panel(""";FLAVOR:Marlin
;TIME:1191
;Filament used: 1.86045m
;Layer height: 0.3
;MINX:145.131
;MINY:159.574
;MINZ:0.3
;MAXX:191.731
;MAXY:206.174
;MAXZ:20
;Generated by jasper
M140 S80
M105
M190 S80
M104 S240
M105
M109 S240
M82 ;absolute extrusion mode
G28 ;Home
G1 Z15.0 F6000 ;Move the platform down 15mm
;Prime the extruder
G92 E0
G1 F200 E3
G92 E0""")
# {if max_layer_z < max_print_height}G1 Z{z_offset+min(max_layer_z+2, max_print_height)} F600{endif} ; Move print bed down
# G1 X50 Y50 F{travel_speed*60} ; move print head out of the way
# {if max_layer_z < max_print_height-10}G1 Z{z_offset+max_print_height-10} F600{endif} ; Move print bed close to the bottom
# M140 S0 ; turn off heatbed
# M104 S0 ; turn off temperature
# M107 ; turn off fan
# M84 X Y E ; disable motors
panel_4 = Panel("""G91 ;Relative positioning
G1 E-2 F2700 ;Retract a bit
G1 E-2 Z0.2 F2400 ;Retract and raise Z
G1 X5 Y5 F3000 ;Wipe out
G1 Z10 ;Raise Z more
G90 ;Absolute positionning""")
concat_2 = Concatenate(FragmentC="G1 F", FragmentA=multiplication)  # -> flatten(Result)
panel_5 = Panel(concat_2)
merge = Merge(Data1=panel_3, Data2=concat_2, Data3=flatten(concat), Data4=panel_4)
panel_6 = Panel(merge)
relay = ClusterOutput(merge)

# ==== cluster ExtrusionCalculator
relay = ClusterInput()
relay_2 = ClusterInput()
relay_3 = ClusterInput()
relay_4 = ClusterInput()
V = ClusterInput()

# ---- group: Flow Calculations
multiplication = Multiplication(A=relay_2, B=relay_3)
division = Division(A=relay, B="2")
sqr = Square(Value=division)
pi = Pi(Factor=sqr)
division_2 = Division(A=multiplication, B=pi)
vlen = VectorLength(Vector=V)
multiplication_2 = Multiplication(A=vlen, B=division_2)
multiplication_3 = Multiplication(A=multiplication_2, B=relay_4)
ma = MassAddition(Input=flatten(multiplication_3))  # -> Result, PartialResults

# ----
pr = ClusterOutput(ma.PartialResults)
